# Grasshopper definition planeIntersections.gh (Grasshopper 0.9.61)
# plug-ins: Python Interpreter

crv = Curve(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)
crv_2 = Curve(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)
planar = Planar(Curve=crv_2)  # -> Planar, Plane, Deviation
planar_2 = Planar(Curve=crv)  # -> Planar, Plane, Deviation
python = PythonScript(planeA=planar_2.Plane, planeB=planar.Plane, reset=Button())  # -> out, a; inputs planeA: Plane, planeB: Plane
# ---------- python: Python ----------
import sys
import scriptcontext as sc
path = "C:\\Users\\bgolder\\projects\\pygeom"
if path not in sys.path:
    sys.path.append(path)
    import pygeom as pg
else:
    reload(pg)
reload(pg)
if planeA and planeB:
    planeA = pg.rhino.importFromRhino(planeA)
    planeB = pg.rhino.importFromRhino(planeB)
    line = planeA.intersect(planeB)
    print line
    rLine = pg.rhino.exportToRhino(line)
    print rLine
    a = rLine
# ---------- end python ----------
ppx = PlanePlane(PlaneA=planar_2.Plane, PlaneB=planar.Plane)
crv_3 = Curve(python.a)
crv_4 = Curve(ppx)
